# Grasshopper definition DATA_PROCESSING.gh (Grasshopper 0.9.76)
# plug-ins: Python Interpreter, Anemone, gHowl, Firefly.Core

panel = Panel("""!ANG:-0.01,0.01,-0.00,AN:141,-132,-9,-15,-3,-229,0.00,0.00,0.00
!ANG:0.03,-0.01,-0.00,AN:151,-132,-9,-15,-2,-229,0.00,0.00,0.00
!ANG:0.03,-0.04,-0.00,AN:148,-132,-8,-14,-3,-229,0.00,0.00,0.00
!ANG:0.08,0.02,-0.01,AN:142,-129,-10,-16,-2,-228,0.00,0.00,0.00
!ANG:0.06,-0.13,-0.02,AN:149,-136,-9,-16,-3,-228,0.00,0.00,0.00
!ANG:0.09,-0.23,-0.01,AN:140,-138,-6,-14,-3,-228,0.45,0.54,2.42
!ANG:0.15,-0.13,-3.63,AN:151,-135,-9,-16,-2,-229,0.45,0.54,2.42
!ANG:0.16,-0.25,-7.04,AN:156,-140,-6,-14,-2,-228,0.45,0.54,2.42
!ANG:0.14,-0.14,-10.22,AN:155,-133,-7,-16,-3,-228,0.45,0.54,2.42
!ANG:0.26,-0.21,-13.30,AN:164,-134,-8,-15,-3,-230,0.45,0.54,2.42
!ANG:0.36,-0.12,-16.15,AN:171,-119,-11,-15,-4,-229,0.45,0.54,2.42
!ANG:0.63,-0.08,-18.88,AN:194,-126,-7,-14,-3,-231,0.44,0.55,2.43
!ANG:1.66,-0.27,-20.51,AN:389,-188,175,-21,-1,-230,0.44,0.55,2.43
!ANG:10.62,1.95,-23.42,AN:2177,315,-169,-17,7,-279,0.44,0.55,2.43
!ANG:25.72,3.12,-10.95,AN:3748,1435,2727,-19,-141,119,0.44,0.55,2.43
!ANG:29.53,-4.59,-10.71,AN:58,-1198,1257,25,26,-186,0.44,0.55,2.43
!ANG:22.76,-1.22,-12.78,AN:291,42,34,-23,-11,-223,0.44,0.55,2.43
!ANG:15.70,-0.63,-15.88,AN:68,84,-168,-20,-11,-230,0.55,0.65,2.36
!ANG:10.80,-0.37,-12.36,AN:132,-101,-36,-26,-13,-226,0.55,0.65,2.36
!ANG:7.85,0.40,-9.67,AN:135,123,-204,-25,-13,-230,0.55,0.65,2.36
!ANG:6.38,0.46,-6.76,AN:237,57,-80,-23,-12,-234,0.55,0.65,2.36
!ANG:4.45,-0.49,-4.06,AN:43,-193,-31,4,-17,-226,0.55,0.65,2.36
!ANG:4.18,1.21,-1.31,AN:151,-103,0,-8,-21,-225,0.55,0.65,2.36
!ANG:3.87,0.21,0.77,AN:85,-375,-79,-14,-10,-253,0.43,0.70,2.34
!ANG:3.95,-1.54,-1.51,AN:297,-488,258,-8,-7,-230,0.43,0.70,2.34
!ANG:3.47,0.39,-4.71,AN:282,65,9,-20,-20,-242,0.43,0.70,2.34
!ANG:5.31,0.67,-6.61,AN:538,39,225,-10,-23,-226,0.43,0.70,2.34
!ANG:6.16,1.26,-7.52,AN:369,8,431,-24,-32,-218,0.43,0.70,2.34
!ANG:6.95,0.40,-10.36,AN:262,-100,-6,-5,-41,-223,0.43,0.70,2.34
!ANG:-0.07,-0.49,-11.30,AN:-1472,-370,409,-3,12,-203,0.51,0.76,2.31
!ANG:-3.88,-0.45,-13.54,AN:-424,-271,45,-21,7,-236,0.51,0.76,2.31
!ANG:-5.19,-0.32,-15.46,AN:-256,-33,70,-20,22,-225,0.51,0.76,2.31
!ANG:-5.47,-0.42,-18.17,AN:110,-72,-120,-34,10,-231,0.51,0.76,2.31
!ANG:-8.10,-1.07,-20.79,AN:-595,56,-131,-11,31,-242,0.51,0.76,2.31
!ANG:-7.56,-0.21,-23.75,AN:188,-55,-241,-8,72,-215,0.51,0.76,2.31
!ANG:-8.20,-0.01,-26.94,AN:688,-155,-363,-13,50,-224,0.43,0.15,2.54
!ANG:-9.88,0.31,-28.60,AN:71,-87,32,-25,58,-221,0.43,0.15,2.54
!ANG:-12.22,-0.54,-30.31,AN:-82,-100,-28,-11,64,-218,0.43,0.15,2.54
!ANG:-15.69,-0.83,-28.29,AN:-324,-452,649,33,105,-195,0.43,0.15,2.54
!ANG:-22.29,3.96,-29.72,AN:-466,17,145,-22,86,-217,0.43,0.15,2.54
!ANG:-23.06,2.72,-34.21,AN:-160,252,-509,1,110,-208,0.43,0.15,2.54
!ANG:-30.82,3.15,-37.29,AN:-1200,110,-283,-22,69,-219,0.32,-0.30,2.64
!ANG:-36.31,0.18,-43.22,AN:-2005,208,-821,-35,179,-147,0.32,-0.30,2.64
!ANG:-43.47,-0.31,-42.40,AN:-539,-211,481,-14,152,-163,0.32,-0.30,2.64
!ANG:-39.04,5.52,-42.67,AN:726,515,889,27,149,-175,0.32,-0.30,2.64
!ANG:-36.15,11.37,-43.11,AN:568,466,685,58,145,-154,0.32,-0.30,2.64
!ANG:-23.14,11.45,-38.82,AN:2759,-993,803,4,133,-181,0.32,-0.30,2.64
!ANG:-9.67,9.15,-35.12,AN:3282,-504,1191,49,207,-329,0.36,0.17,2.23
!ANG:-9.65,9.03,-35.95,AN:133,-188,130,42,39,-242,0.36,0.17,2.23
!ANG:-8.10,10.87,-36.38,AN:386,37,217,0,18,-199,0.36,0.17,2.23
!ANG:-5.34,8.68,-36.90,AN:553,-266,135,33,34,-235,0.36,0.17,2.23
!ANG:-5.26,10.06,-38.09,AN:338,47,71,14,7,-211,0.36,0.17,2.23
!ANG:-4.36,11.03,-38.47,AN:136,254,176,39,23,-237,0.36,0.17,2.23
!ANG:-5.34,12.19,-40.04,AN:39,92,-39,19,13,-211,0.60,0.52,1.64
!ANG:-5.12,10.03,-39.23,AN:82,-353,58,23,6,-211,0.60,0.52,1.64
!ANG:-4.79,7.93,-39.62,AN:55,-498,-208,22,24,-214,0.60,0.52,1.64
!ANG:-5.17,7.24,-41.01,AN:203,-285,-360,15,16,-225,0.60,0.52,1.64
!ANG:-4.61,7.06,-40.77,AN:196,-121,-51,9,18,-230,0.60,0.52,1.64
!ANG:-3.85,6.49,-40.83,AN:314,-111,-99,10,25,-224,0.60,0.52,1.64
!ANG:-4.61,5.92,-40.71,AN:164,-179,-49,17,20,-231,0.59,0.45,1.58
!ANG:-5.16,6.10,-40.65,AN:63,-160,-69,12,21,-236,0.59,0.45,1.58
!ANG:-5.54,5.46,-40.37,AN:63,-240,-30,7,13,-223,0.59,0.45,1.58
!ANG:-6.12,5.02,-40.39,AN:-108,-178,-98,1,26,-224,0.59,0.45,1.58
!ANG:-8.00,4.45,-40.41,AN:-213,-133,-81,10,39,-231,0.59,0.45,1.58
!ANG:-10.26,4.72,-40.76,AN:-225,-119,-138,9,40,-228,0.59,0.45,1.58
!ANG:-11.72,5.07,-40.92,AN:-196,-74,-110,3,49,-219,0.60,0.37,1.63
!ANG:-13.55,4.37,-41.86,AN:-214,-158,-188,1,59,-217,0.60,0.37,1.63
!ANG:-16.16,3.66,-41.69,AN:-341,-224,12,14,88,-227,0.60,0.37,1.63
!ANG:-19.73,4.67,-41.98,AN:-347,-80,-19,4,82,-213,0.60,0.37,1.63
!ANG:-22.11,4.63,-41.86,AN:-381,-114,29,0,81,-212,0.60,0.37,1.63
!ANG:-23.97,3.97,-41.61,AN:-444,-186,15,16,100,-220,0.60,0.37,1.63
!ANG:-26.37,5.55,-41.02,AN:-448,-58,169,-2,108,-187,0.54,-0.01,1.78
!ANG:-29.36,5.04,-41.39,AN:-403,-98,55,21,124,-201,0.54,-0.01,1.78
!ANG:-32.40,6.25,-41.21,AN:-505,-161,145,-6,132,-184,0.54,-0.01,1.78
!ANG:-35.51,5.84,-41.27,AN:-465,-3,188,5,156,-178,0.54,-0.01,1.78
!ANG:-39.73,5.11,-41.68,AN:-573,-178,0,16,177,-173,0.54,-0.01,1.78
!ANG:-43.35,6.53,-41.89,AN:-440,-35,181,16,168,-161,0.54,-0.01,1.78
!ANG:-45.47,7.27,-42.06,AN:-362,-80,122,25,177,-165,0.48,-0.42,1.80
!ANG:-47.34,8.61,-42.65,AN:-405,-58,179,15,176,-146,0.48,-0.42,1.80
!ANG:-49.94,8.58,-43.01,AN:-484,-135,163,19,210,-129,0.48,-0.42,1.80
!ANG:-54.38,8.74,-43.78,AN:-457,-113,152,27,197,-119,0.48,-0.42,1.80
!ANG:-57.18,9.78,-44.42,AN:-453,-86,156,33,207,-114,0.48,-0.42,1.80
!ANG:-59.41,10.66,-45.16,AN:-376,-83,103,42,217,-99,0.48,-0.42,1.80
!ANG:-63.17,11.92,-46.14,AN:-538,-57,91,42,217,-94,0.38,-0.97,1.62
!ANG:-67.14,12.97,-47.30,AN:-777,67,82,35,249,-64,0.38,-0.97,1.62
!ANG:-71.93,12.34,-48.52,AN:-603,-13,3,42,243,-44,0.38,-0.97,1.62
!ANG:-75.78,12.36,-49.73,AN:-466,-3,-40,45,216,-32,0.38,-0.97,1.62
!ANG:-79.05,13.51,-50.30,AN:-549,-48,86,35,239,-17,0.38,-0.97,1.62
!ANG:-82.71,13.69,-51.00,AN:-523,-21,163,53,259,-13,0.38,-0.97,1.62
!ANG:-85.64,13.86,-51.60,AN:-499,-35,-23,63,266,-3,0.24,-1.49,1.18
!ANG:-88.81,14.37,-51.94,AN:-626,-146,-39,40,246,27,0.24,-1.49,1.18
!ANG:-93.64,13.57,-53.10,AN:-696,-24,-10,52,225,41,0.24,-1.49,1.18
!ANG:-97.56,13.58,-53.49,AN:-643,-126,-156,41,232,64,0.24,-1.49,1.18
!ANG:-102.39,11.37,-53.59,AN:-732,-137,-426,43,239,81,0.24,-1.49,1.18
!ANG:-106.36,10.68,-53.50,AN:-605,-167,-273,30,237,103,0.24,-1.49,1.18
!ANG:-111.24,8.82,-53.48,AN:-701,-125,-326,30,234,120,0.26,-1.71,0.76
!ANG:-115.83,7.79,-54.14,AN:-731,-121,-290,30,223,132,0.26,-1.71,0.76
!ANG:-119.51,7.64,-54.58,AN:-641,-163,-225,21,218,144,0.26,-1.71,0.76
!ANG:-123.11,5.93,-55.30,AN:-658,-1,-332,13,212,164,0.26,-1.71,0.76
!ANG:-127.26,4.45,-55.30,AN:-725,-119,-361,-5,191,190,0.26,-1.71,0.76
!ANG:-132.61,2.13,-55.19,AN:-707,-128,-366,6,182,185,0.26,-1.71,0.76
!ANG:-136.03,1.64,-55.15,AN:-646,-107,-332,-12,162,209,0.53,-1.69,0.06
!ANG:-141.21,-0.02,-54.43,AN:-716,-150,-388,-8,160,215,0.53,-1.69,0.06
!ANG:-145.09,-0.47,-53.84,AN:-708,-166,-340,-14,134,232,0.53,-1.69,0.06
!ANG:-149.66,-0.94,-53.66,AN:-629,-158,-250,-23,126,247,0.53,-1.69,0.06
!ANG:-153.16,-1.53,-53.93,AN:-494,-176,-132,-25,113,252,0.53,-1.69,0.06
!ANG:-156.59,-2.03,-54.30,AN:-507,-167,-112,-22,101,250,0.53,-1.69,0.06
!ANG:-158.76,-2.19,-55.08,AN:-344,-116,-46,-21,78,261,0.75,-1.31,-0.47
!ANG:-161.65,-1.69,-55.66,AN:-245,-154,124,-14,62,261,0.75,-1.31,-0.47
!ANG:-164.14,-1.09,-56.29,AN:-141,-111,127,-14,51,259,0.75,-1.31,-0.47
!ANG:-166.18,-1.50,-56.63,AN:-58,21,44,-17,57,261,0.75,-1.31,-0.47
!ANG:-166.33,-2.78,-56.98,AN:98,183,16,-24,66,265,0.75,-1.31,-0.47
!ANG:-165.54,-4.60,-57.61,AN:154,291,45,-34,44,267,0.75,-1.31,-0.47
!ANG:-166.68,-6.97,-57.47,AN:155,324,-84,-38,51,263,0.77,-1.18,-0.57
!ANG:-166.17,-9.25,-57.70,AN:283,396,-45,-49,58,268,0.77,-1.18,-0.57
!ANG:-164.15,-11.41,-59.16,AN:481,445,176,-77,74,269,0.77,-1.18,-0.57
!ANG:-162.56,-15.28,-59.78,AN:310,451,-18,-72,57,269,0.77,-1.18,-0.57
!ANG:-163.08,-17.76,-59.52,AN:305,499,-106,-93,36,265,0.77,-1.18,-0.57
!ANG:-164.00,-21.35,-59.51,AN:459,548,28,-82,45,237,0.77,-1.18,-0.57
!ANG:-162.20,-23.08,-60.25,AN:578,443,88,-96,72,229,1.04,-1.20,-0.36
!ANG:-159.09,-26.08,-61.78,AN:504,627,42,-114,80,218,1.04,-1.20,-0.36
!ANG:-154.77,-29.77,-63.90,AN:648,684,73,-140,88,219,1.04,-1.20,-0.36
!ANG:-151.69,-33.71,-65.52,AN:528,656,14,-152,102,200,1.04,-1.20,-0.36
!ANG:-147.23,-36.47,-67.66,AN:583,474,72,-175,112,178,1.04,-1.20,-0.36
!ANG:-142.26,-41.07,-69.52,AN:613,516,-131,-179,113,177,1.04,-1.20,-0.36
!ANG:-137.98,-44.83,-71.53,AN:593,659,-125,-155,126,158,1.22,-1.32,0.16
!ANG:-132.11,-45.35,-75.68,AN:602,583,31,-176,116,142,1.22,-1.32,0.16
!ANG:-127.40,-46.54,-78.05,AN:734,380,76,-206,129,133,1.22,-1.32,0.16
!ANG:-123.10,-49.83,-80.60,AN:583,513,-122,-202,129,111,1.22,-1.32,0.16
!ANG:-117.49,-51.92,-83.89,AN:604,438,-70,-202,130,87,1.22,-1.32,0.16
!ANG:-110.72,-53.34,-88.22,AN:599,442,-10,-218,143,82,1.22,-1.32,0.16
!ANG:-103.19,-53.29,-92.55,AN:786,473,167,-223,148,60,1.20,-1.29,0.73
!ANG:-94.72,-52.75,-98.10,AN:913,450,227,-206,144,40,1.20,-1.29,0.73
!ANG:-88.07,-51.81,-101.82,AN:840,350,196,-201,158,22,1.20,-1.29,0.73
!ANG:-81.78,-50.75,-105.39,AN:765,376,13,-204,154,4,1.20,-1.29,0.73
!ANG:-75.09,-49.37,-108.74,AN:857,415,148,-208,143,-5,1.20,-1.29,0.73
!ANG:-69.99,-48.22,-110.21,AN:849,344,310,-207,136,-28,1.20,-1.29,0.73
!ANG:-64.62,-47.97,-111.96,AN:737,260,183,-197,152,-46,1.03,-1.19,1.11
!ANG:-60.90,-46.28,-114.59,AN:600,203,106,-195,154,-58,1.03,-1.19,1.11
!ANG:-57.65,-44.37,-116.31,AN:637,169,172,-191,129,-65,1.03,-1.19,1.11
!ANG:-52.65,-43.05,-118.56,AN:801,253,283,-183,131,-75,1.03,-1.19,1.11
!ANG:-49.14,-40.47,-119.07,AN:798,264,474,-171,154,-92,1.03,-1.19,1.11
!ANG:-47.46,-35.91,-117.58,AN:830,250,675,-161,162,-110,1.03,-1.19,1.11
!ANG:-45.62,-31.96,-116.08,AN:828,150,621,-144,135,-123,0.71,-0.96,1.47
!ANG:-41.92,-28.69,-115.80,AN:863,92,707,-151,130,-125,0.71,-0.96,1.47
!ANG:-38.73,-26.96,-114.96,AN:919,113,751,-124,132,-139,0.71,-0.96,1.47
!ANG:-36.55,-24.27,-113.07,AN:837,-73,765,-103,139,-158,0.71,-0.96,1.47
!ANG:-35.33,-20.54,-110.73,AN:718,-146,840,-113,141,-152,0.71,-0.96,1.47
!ANG:-36.10,-19.27,-108.37,AN:475,-185,796,-93,127,-172,0.71,-0.96,1.47
!ANG:-33.34,-16.26,-106.92,AN:687,-121,866,-88,111,-149,0.51,-0.54,1.66
!ANG:-30.62,-15.59,-102.68,AN:808,-215,683,-85,127,-175,0.51,-0.54,1.66
!ANG:-29.96,-13.55,-98.28,AN:572,-90,821,-67,117,-191,0.51,-0.54,1.66
!ANG:-27.75,-9.73,-93.62,AN:637,3,1087,-57,111,-184,0.51,-0.54,1.66
!ANG:-26.19,-7.50,-90.44,AN:580,-16,815,-49,101,-179,0.51,-0.54,1.66
!ANG:-25.20,-5.70,-88.10,AN:425,-7,675,-29,110,-200,0.51,-0.54,1.66
!ANG:-24.26,-3.00,-86.62,AN:448,26,550,-19,111,-211,0.48,-0.18,1.73
!ANG:-23.31,-0.86,-82.96,AN:413,12,397,-19,95,-199,0.48,-0.18,1.73
!ANG:-22.21,-0.07,-80.12,AN:365,-48,266,-14,101,-218,0.48,-0.18,1.73
!ANG:-20.91,0.51,-77.50,AN:449,-103,232,-12,92,-214,0.48,-0.18,1.73
!ANG:-19.56,1.21,-75.37,AN:444,-49,191,-10,87,-217,0.48,-0.18,1.73
!ANG:-18.35,2.28,-73.38,AN:422,40,234,-11,86,-213,0.48,-0.18,1.73
!ANG:-17.70,2.69,-71.49,AN:409,-3,246,-3,82,-225,0.44,0.02,1.77
!ANG:-16.47,3.96,-68.43,AN:437,70,337,6,76,-232,0.44,0.02,1.77
!ANG:-15.96,4.58,-66.54,AN:275,-45,106,4,70,-219,0.44,0.02,1.77
!ANG:-15.51,5.53,-64.52,AN:258,63,183,11,75,-232,0.44,0.02,1.77
!ANG:-15.71,6.73,-63.12,AN:174,111,100,15,70,-229,0.44,0.02,1.77
!ANG:-15.77,7.52,-62.37,AN:149,79,-30,18,66,-213,0.44,0.02,1.77
!ANG:-15.48,8.07,-62.01,AN:237,30,-116,26,77,-217,0.31,0.21,1.85
!ANG:-16.07,9.05,-61.97,AN:224,35,-78,23,70,-223,0.31,0.21,1.85
!ANG:-16.11,8.89,-61.78,AN:164,-74,-100,19,74,-222,0.31,0.21,1.85
!ANG:-16.47,9.07,-61.50,AN:155,35,-40,28,69,-226,0.31,0.21,1.85
!ANG:-16.32,9.95,-61.05,AN:138,58,-5,19,66,-209,0.31,0.21,1.85
!ANG:-16.17,9.75,-60.80,AN:184,-9,-53,21,59,-214,0.31,0.21,1.85
!ANG:-15.59,9.51,-60.29,AN:151,-57,-30,32,70,-213,0.18,0.20,1.87
!ANG:-16.03,10.13,-60.17,AN:147,-68,-18,31,66,-212,0.18,0.20,1.87
!ANG:-16.49,8.99,-59.92,AN:54,-365,-92,37,68,-190,0.18,0.20,1.87
!ANG:-17.05,8.63,-59.85,AN:120,-389,-121,33,68,-217,0.18,0.20,1.87
!ANG:-16.51,7.91,-60.35,AN:212,-356,-253,14,67,-214,0.18,0.20,1.87
!ANG:-17.11,6.10,-60.83,AN:18,-332,-246,6,59,-217,0.18,0.20,1.87
!ANG:-17.13,4.14,-61.37,AN:-47,-358,-299,8,82,-210,0.06,0.08,2.08
!ANG:-17.79,3.88,-63.04,AN:199,-182,-232,-9,75,-215,0.06,0.08,2.08
!ANG:-17.31,3.25,-63.80,AN:246,-57,-40,-10,79,-219,0.06,0.08,2.08
!ANG:-17.00,2.83,-63.99,AN:280,-70,67,5,74,-229,0.06,0.08,2.08
!ANG:-16.28,3.69,-64.40,AN:277,-42,14,0,68,-212,0.06,0.08,2.08
!ANG:-15.78,3.75,-65.09,AN:271,-75,-65,4,63,-217,0.06,0.08,2.08
!ANG:-15.02,3.65,-65.83,AN:259,-155,-110,5,62,-220,0.01,0.09,2.16
!ANG:-14.53,3.68,-67.52,AN:229,-139,-159,-12,69,-212,0.01,0.09,2.16
!ANG:-12.21,3.72,-66.29,AN:724,-17,468,3,75,-212,0.01,0.09,2.16
!ANG:-10.49,5.76,-65.03,AN:868,177,553,-3,41,-229,0.01,0.09,2.16
!ANG:-8.19,3.73,-66.11,AN:562,-327,-50,7,28,-229,0.01,0.09,2.16
!ANG:-6.62,1.31,-66.03,AN:362,-737,127,17,35,-214,0.01,0.09,2.16
!ANG:-7.90,3.65,-66.61,AN:24,-36,97,-8,9,-228,0.15,0.46,2.12
!ANG:-3.85,1.32,-67.65,AN:651,-484,-163,-14,25,-224,0.15,0.46,2.12
!ANG:-2.22,1.07,-67.26,AN:639,-105,192,-26,1,-239,0.15,0.46,2.12
!ANG:1.11,-0.10,-67.83,AN:742,-134,-2,-22,-15,-235,0.15,0.46,2.12
!ANG:3.75,-1.56,-68.70,AN:567,-326,-64,-28,-12,-227,0.15,0.46,2.12
!ANG:3.10,-1.99,-69.15,AN:129,-107,-9,-33,-22,-227,0.15,0.46,2.12
!ANG:3.46,-2.76,-69.73,AN:123,-130,-35,-32,-22,-230,0.34,0.80,2.07
!ANG:3.99,-3.49,-69.58,AN:191,-190,15,-33,-24,-223,0.34,0.80,2.07
!ANG:5.09,-4.20,-69.23,AN:315,-219,62,-34,-21,-228,0.34,0.80,2.07""")
panel_2 = Panel("""!ANG:0.00,-0.00,0.00,AN:148,-129,-8,-15,-2,-229,0.00,0.00,0.00
!ANG:-0.01,-0.03,0.00,AN:142,-129,-8,-14,-2,-229,0.00,0.00,0.00
!ANG:-0.03,-0.01,-0.00,AN:141,-126,-9,-14,-3,-229,0.00,0.00,0.00
!ANG:0.05,-0.01,-0.00,AN:147,-129,-8,-14,-2,-230,0.00,0.00,0.00
!ANG:0.03,-0.00,-0.01,AN:146,-127,-10,-15,-3,-230,0.00,0.00,0.00
!ANG:0.08,-0.08,-0.02,AN:145,-129,-9,-15,-3,-230,0.50,0.69,2.01
!ANG:0.11,-0.13,-3.79,AN:143,-127,-9,-14,-3,-231,0.50,0.69,2.01
!ANG:0.14,-0.08,-7.37,AN:146,-128,-9,-15,-3,-228,0.50,0.69,2.01
!ANG:0.17,-0.13,-10.71,AN:149,-129,-8,-15,-3,-230,0.50,0.69,2.01
!ANG:0.17,-0.17,-13.95,AN:144,-129,-9,-15,-2,-228,0.50,0.69,2.01
!ANG:0.12,-0.20,-16.95,AN:148,-129,-9,-16,-2,-229,0.50,0.69,2.01
!ANG:0.08,-0.30,-19.79,AN:147,-130,-8,-15,-3,-229,0.49,0.68,2.01
!ANG:0.13,-0.28,-22.48,AN:149,-130,-6,-16,-3,-229,0.49,0.68,2.01
!ANG:0.18,-0.34,-24.95,AN:150,-129,-8,-15,-3,-230,0.49,0.68,2.01
!ANG:0.18,-0.30,-27.28,AN:145,-128,-9,-15,-3,-230,0.49,0.68,2.01
!ANG:0.19,-0.29,-29.41,AN:148,-131,-7,-15,-4,-229,0.49,0.68,2.01
!ANG:0.25,-0.26,-31.42,AN:142,-128,-9,-15,-2,-230,0.49,0.68,2.01
!ANG:0.15,-0.26,-33.27,AN:145,-129,-7,-15,-3,-229,0.50,0.68,2.01
!ANG:0.15,-0.25,-34.91,AN:142,-129,-7,-15,-3,-229,0.50,0.68,2.01
!ANG:0.13,-0.25,-36.47,AN:138,-129,-9,-16,-2,-229,0.50,0.68,2.01
!ANG:0.05,-0.34,-37.89,AN:141,-132,-8,-15,-2,-229,0.50,0.68,2.01
!ANG:0.00,-0.32,-39.19,AN:142,-132,-9,-15,-3,-230,0.50,0.68,2.01
!ANG:0.13,-0.31,-40.41,AN:158,-134,-10,-15,-3,-229,0.50,0.68,2.01
!ANG:0.25,-0.30,-41.53,AN:166,-133,-9,-14,-3,-230,0.50,0.68,2.01
!ANG:0.26,-0.27,-42.50,AN:153,-143,6,-15,-3,-230,0.50,0.68,2.01
!ANG:0.27,-1.28,-43.63,AN:148,-345,-43,-16,-3,-230,0.50,0.68,2.01
!ANG:1.23,-2.50,-45.01,AN:341,-447,-109,-24,11,-227,0.50,0.68,2.01
!ANG:-0.83,-2.86,-46.91,AN:19,-208,-245,-36,-21,-218,0.50,0.68,2.01
!ANG:2.39,-3.55,-47.61,AN:436,-122,2,-24,16,-223,0.50,0.68,2.01
!ANG:-0.74,-2.91,-48.96,AN:-82,-68,-209,-28,-27,-226,0.54,0.72,1.97
!ANG:0.31,-0.71,-51.43,AN:-100,322,-343,-58,9,-220,0.54,0.72,1.97
!ANG:-0.42,-4.00,-53.00,AN:168,-162,-252,-3,-4,-220,0.54,0.72,1.97
!ANG:5.64,5.81,-52.81,AN:1326,1445,0,-24,-12,-241,0.54,0.72,1.97
!ANG:3.19,2.55,-53.64,AN:-116,-258,-90,0,4,-236,0.54,0.72,1.97
!ANG:3.70,-1.74,-50.61,AN:595,-1045,773,-23,-34,-280,0.54,0.72,1.97
!ANG:3.36,-0.19,-51.91,AN:-34,167,-178,-15,-15,-234,0.49,0.74,1.93
!ANG:2.98,-0.39,-51.70,AN:109,-159,92,-20,-10,-232,0.49,0.74,1.93
!ANG:2.52,-0.74,-51.99,AN:141,-132,-8,-23,-12,-229,0.49,0.74,1.93
!ANG:2.00,-0.85,-52.68,AN:61,-60,-97,-22,-12,-225,0.49,0.74,1.93
!ANG:4.41,-0.48,-49.67,AN:643,70,660,-5,-6,-239,0.49,0.74,1.93
!ANG:4.38,1.01,-48.67,AN:386,43,288,-12,-13,-226,0.49,0.74,1.93
!ANG:5.86,1.61,-47.83,AN:587,65,266,-13,-23,-233,0.50,0.77,1.92
!ANG:6.66,1.24,-47.33,AN:405,-92,124,-9,-29,-227,0.50,0.77,1.92
!ANG:7.68,1.03,-47.73,AN:407,-169,-54,-16,-53,-218,0.50,0.77,1.92
!ANG:5.80,-1.19,-47.67,AN:-518,-479,64,-12,-38,-232,0.50,0.77,1.92
!ANG:6.13,-0.16,-46.74,AN:64,-15,198,-19,-11,-238,0.50,0.77,1.92
!ANG:5.95,-0.14,-45.85,AN:407,-34,211,-19,-27,-225,0.50,0.77,1.92
!ANG:5.00,0.12,-45.55,AN:-27,8,99,11,-23,-274,0.55,0.83,1.88
!ANG:4.60,2.00,-45.26,AN:113,42,98,-20,-15,-270,0.55,0.83,1.88
!ANG:5.36,1.71,-45.41,AN:434,-7,16,-30,-27,-266,0.55,0.83,1.88
!ANG:5.02,0.59,-45.23,AN:102,-72,84,0,-48,-282,0.55,0.83,1.88
!ANG:4.27,1.70,-46.04,AN:-179,6,-133,-3,-24,-316,0.55,0.83,1.88
!ANG:2.56,3.03,-46.93,AN:-189,148,-167,-18,-9,-344,0.55,0.83,1.88
!ANG:1.33,4.45,-48.37,AN:-66,196,-279,6,-14,-275,0.46,0.61,1.57
!ANG:1.14,4.28,-49.89,AN:87,-135,-398,5,-15,-279,0.46,0.61,1.57
!ANG:0.82,3.37,-52.03,AN:47,-288,-546,29,3,-270,0.46,0.61,1.57
!ANG:-3.71,4.89,-52.94,AN:-713,-61,-311,22,-1,-270,0.46,0.61,1.57
!ANG:-4.39,3.54,-52.78,AN:-177,-510,-159,31,-2,-148,0.46,0.61,1.57
!ANG:-1.39,4.54,-52.32,AN:664,-148,-65,-1,52,-136,0.46,0.61,1.57
!ANG:-0.52,3.84,-50.55,AN:600,-274,254,0,1,-144,0.53,0.30,1.50
!ANG:-0.57,3.24,-48.23,AN:145,-271,101,19,5,-151,0.53,0.30,1.50
!ANG:-0.67,2.84,-46.74,AN:167,-366,-49,-5,19,-172,0.53,0.30,1.50
!ANG:0.15,2.24,-44.21,AN:489,-241,207,-17,41,-125,0.53,0.30,1.50
!ANG:-1.07,2.85,-42.58,AN:59,27,52,-24,14,-132,0.53,0.30,1.50
!ANG:-0.56,2.31,-41.17,AN:315,-171,47,11,-4,-155,0.53,0.30,1.50
!ANG:2.33,4.58,-39.04,AN:704,243,197,-23,-4,-148,0.62,0.33,1.48
!ANG:5.87,5.77,-37.36,AN:918,290,115,45,-61,-194,0.62,0.33,1.48
!ANG:9.78,8.75,-35.10,AN:423,53,192,-18,-61,-213,0.62,0.33,1.48
!ANG:12.29,9.23,-35.32,AN:444,551,-358,23,-70,-263,0.62,0.33,1.48
!ANG:13.38,11.20,-32.66,AN:242,481,254,63,-66,-289,0.62,0.33,1.48
!ANG:18.22,11.84,-29.49,AN:1098,86,498,43,-73,-301,0.62,0.33,1.48
!ANG:19.00,12.52,-29.28,AN:502,85,-41,59,-64,-329,0.43,0.70,1.21
!ANG:14.40,12.72,-29.15,AN:-677,-107,-79,49,-17,-299,0.43,0.70,1.21
!ANG:13.80,10.65,-29.14,AN:484,-472,67,38,15,-268,0.43,0.70,1.21
!ANG:7.50,8.35,-30.84,AN:-185,-636,-212,25,31,-237,0.43,0.70,1.21
!ANG:0.20,5.94,-33.07,AN:-297,-651,-426,29,7,-252,0.43,0.70,1.21
!ANG:-1.15,4.84,-33.47,AN:28,-535,-257,-8,-8,-255,0.43,0.70,1.21
!ANG:-2.56,3.06,-33.78,AN:-278,-262,-282,11,-42,-290,0.44,0.56,1.35
!ANG:-1.02,3.85,-36.13,AN:38,-38,-275,-26,-75,-168,0.44,0.56,1.35
!ANG:2.87,4.75,-36.98,AN:162,302,-52,20,-108,-121,0.44,0.56,1.35
!ANG:9.20,5.12,-37.02,AN:755,-206,90,34,-105,-205,0.44,0.56,1.35
!ANG:17.05,8.19,-37.85,AN:766,34,-179,28,-120,-190,0.44,0.56,1.35
!ANG:21.04,9.91,-40.22,AN:278,-64,-504,44,-104,-195,0.44,0.56,1.35
!ANG:22.13,12.09,-41.67,AN:168,-25,-286,37,-79,-227,0.34,0.47,1.29
!ANG:21.15,12.88,-38.82,AN:309,79,-108,69,-100,-243,0.34,0.47,1.29
!ANG:21.97,14.24,-36.03,AN:380,-52,-89,66,-115,-202,0.34,0.47,1.29
!ANG:20.34,17.11,-34.91,AN:-381,41,-524,81,-136,-233,0.34,0.47,1.29
!ANG:22.30,16.26,-33.00,AN:263,-422,-199,40,-138,-189,0.34,0.47,1.29
!ANG:22.45,15.08,-33.72,AN:-298,-397,-819,14,-178,-209,0.34,0.47,1.29
!ANG:23.33,13.81,-32.29,AN:-398,-42,-562,-49,-95,-181,0.31,0.51,1.24
!ANG:25.92,7.45,-28.95,AN:649,-116,176,-70,-98,-204,0.31,0.51,1.24
!ANG:23.44,0.73,-23.13,AN:-70,209,622,-69,-69,-280,0.31,0.51,1.24
!ANG:17.84,-1.39,-17.38,AN:-479,127,743,-73,10,-273,0.31,0.51,1.24
!ANG:12.02,-4.26,-6.14,AN:164,191,1920,-75,92,-215,0.31,0.51,1.24
!ANG:2.65,-5.51,5.16,AN:538,338,2008,-13,99,-359,0.31,0.51,1.24
!ANG:3.15,-4.60,12.18,AN:381,157,1540,7,80,-265,0.62,0.54,1.22
!ANG:-0.17,-3.17,12.86,AN:513,-227,881,88,47,-259,0.62,0.54,1.22
!ANG:-3.09,0.95,9.15,AN:65,-367,23,100,31,-203,0.62,0.54,1.22
!ANG:-1.92,7.59,3.68,AN:881,-448,-436,182,-65,-203,0.62,0.54,1.22
!ANG:-3.32,13.09,-3.94,AN:-552,-498,-937,216,-38,-179,0.62,0.54,1.22
!ANG:-3.71,19.95,-12.85,AN:103,-360,-1186,138,-110,-153,0.62,0.54,1.22
!ANG:6.09,26.79,-15.94,AN:404,-243,-850,159,-155,-168,0.74,0.74,1.30
!ANG:13.55,30.63,-18.07,AN:489,-170,-754,129,-153,-160,0.74,0.74,1.30
!ANG:19.41,33.06,-20.14,AN:197,-90,-873,91,-153,-161,0.74,0.74,1.30
!ANG:26.44,31.50,-21.74,AN:544,-212,-771,35,-181,-164,0.74,0.74,1.30
!ANG:30.21,27.74,-23.82,AN:-11,42,-945,4,-182,-145,0.74,0.74,1.30
!ANG:34.70,23.98,-26.16,AN:225,56,-996,-9,-184,-167,0.74,0.74,1.30
!ANG:40.05,19.07,-26.24,AN:610,268,-378,-50,-149,-182,0.18,0.61,1.18
!ANG:39.67,15.24,-22.96,AN:429,850,-617,2,-197,-184,0.18,0.61,1.18
!ANG:40.01,11.51,-18.10,AN:-21,103,287,52,-195,-329,0.18,0.61,1.18
!ANG:40.25,5.95,-10.31,AN:127,-287,1525,42,-112,-416,0.18,0.61,1.18
!ANG:35.33,2.38,-4.88,AN:-838,-320,1003,36,-109,-330,0.18,0.61,1.18
!ANG:25.01,0.62,-2.31,AN:-1828,-426,412,108,-102,-327,0.18,0.61,1.18
!ANG:19.03,-4.17,1.51,AN:-976,-871,801,61,-42,-167,0.46,0.48,1.32
!ANG:15.06,3.64,3.19,AN:-439,521,-66,-30,-10,-109,0.46,0.48,1.32
!ANG:14.48,6.20,3.23,AN:64,372,-335,111,-51,-112,0.46,0.48,1.32
!ANG:20.91,11.95,7.49,AN:1241,412,479,-38,162,-231,0.46,0.48,1.32
!ANG:13.95,5.00,10.84,AN:1040,-653,1253,69,126,-194,0.46,0.48,1.32
!ANG:6.64,7.37,11.76,AN:1277,-565,486,127,24,-263,0.46,0.48,1.32
!ANG:13.94,8.23,9.80,AN:2190,-856,-331,69,15,-265,0.43,0.46,1.37
!ANG:23.47,5.06,12.43,AN:2912,-816,1492,103,32,-145,0.43,0.46,1.37
!ANG:43.79,2.28,15.77,AN:5383,-880,1945,38,-156,-96,0.43,0.46,1.37
!ANG:57.60,-1.01,10.15,AN:2688,-1428,637,-25,-247,-133,0.43,0.46,1.37
!ANG:73.61,-11.64,-0.04,AN:3057,-2471,1603,-22,-84,41,0.43,0.46,1.37
!ANG:80.64,-14.68,-8.88,AN:1175,-1559,365,12,-96,15,0.43,0.46,1.37
!ANG:94.45,-24.02,-15.59,AN:2575,-1239,1961,-70,-271,191,0.87,0.67,-0.49
!ANG:113.22,-8.35,-28.37,AN:2380,-2446,-1682,-51,-160,73,0.87,0.67,-0.49
!ANG:127.24,-2.79,-27.24,AN:2977,-319,-1311,104,-24,230,0.87,0.67,-0.49
!ANG:143.42,8.58,-36.41,AN:1579,-1539,1092,28,-20,197,0.87,0.67,-0.49
!ANG:155.58,9.32,-38.82,AN:2038,-281,397,84,-40,358,0.87,0.67,-0.49
!ANG:165.53,10.62,-41.18,AN:1754,-291,493,68,98,265,0.87,0.67,-0.49
!ANG:-175.23,16.22,-36.29,AN:1712,-754,-524,22,46,256,0.02,-0.89,-0.55
!ANG:-154.39,-8.41,-36.71,AN:3925,4560,-2246,-72,130,230,0.02,-0.89,-0.55
!ANG:-130.48,-35.11,-59.32,AN:2052,7367,-1439,-719,414,146,0.02,-0.89,-0.55
!ANG:-124.31,-45.24,-74.48,AN:-737,2170,240,-730,135,425,0.02,-0.89,-0.55
!ANG:-158.61,-17.76,-31.94,AN:-1374,-7138,-5480,-598,314,26,0.02,-0.89,-0.55
!ANG:-170.11,-6.77,-19.75,AN:-1474,-4346,-908,26,176,128,0.02,-0.89,-0.55
!ANG:-179.40,-8.78,-29.03,AN:-3349,609,555,-112,160,38,1.18,-1.04,-0.15
!ANG:168.07,-13.22,-38.05,AN:-3909,-428,1364,-117,-68,215,1.18,-1.04,-0.15
!ANG:148.40,-4.33,-39.65,AN:-3240,-2604,-577,-113,-65,67,1.18,-1.04,-0.15
!ANG:131.19,3.57,-42.48,AN:-3087,-1702,-650,76,-41,53,1.18,-1.04,-0.15
!ANG:115.37,-4.50,-40.33,AN:-2979,1100,1182,-3,-79,-22,1.18,-1.04,-0.15
!ANG:102.89,-5.23,-32.22,AN:-2070,1441,-260,-62,-248,-241,1.18,-1.04,-0.15
!ANG:89.23,-6.99,-28.06,AN:-1587,741,202,-52,-109,-110,0.93,0.95,-0.00
!ANG:77.60,-7.67,-19.09,AN:-1092,804,295,-34,-84,-129,0.93,0.95,-0.00
!ANG:63.55,-14.45,-9.48,AN:-1414,496,1866,-108,-82,-230,0.93,0.95,-0.00
!ANG:42.31,-18.58,-2.39,AN:-1391,-199,569,-34,-137,-200,0.93,0.95,-0.00
!ANG:33.68,-15.68,0.87,AN:-630,-374,390,-92,2,-386,0.93,0.95,-0.00
!ANG:31.02,-13.93,11.54,AN:78,1136,1431,-3,-42,-312,0.93,0.95,-0.00
!ANG:29.43,-7.32,26.37,AN:952,1997,2017,-271,29,-384,1.39,0.47,0.79
!ANG:29.44,-1.57,29.85,AN:223,1425,390,-128,-23,-110,1.39,0.47,0.79
!ANG:23.26,-6.88,22.73,AN:-907,-755,-785,-234,72,-257,1.39,0.47,0.79
!ANG:16.95,-13.62,16.35,AN:-973,-1219,-609,-77,-12,-243,1.39,0.47,0.79
!ANG:6.17,-9.74,10.30,AN:-1169,529,-1313,2,-31,-172,1.39,0.47,0.79
!ANG:2.73,-0.73,9.78,AN:-586,1249,-36,-82,-60,-143,1.39,0.47,0.79
!ANG:-2.66,-4.17,2.68,AN:-1470,-221,-1332,-55,-27,-77,1.00,0.18,1.32
!ANG:-13.16,-9.44,8.34,AN:-1776,-1427,1105,-240,60,-451,1.00,0.18,1.32
!ANG:-15.19,-3.16,12.90,AN:-147,749,1368,-90,-109,-249,1.00,0.18,1.32
!ANG:-2.89,12.96,-2.46,AN:1689,3841,-2151,-235,4,-248,1.00,0.18,1.32
!ANG:1.15,10.34,-4.62,AN:956,288,-273,-184,235,-276,1.00,0.18,1.32
!ANG:-7.17,10.19,9.20,AN:-2096,-517,2878,16,110,-73,1.00,0.18,1.32
!ANG:-13.00,5.28,24.11,AN:-1053,-1893,3127,-165,12,-401,0.59,-0.04,1.46
!ANG:-14.84,4.56,20.48,AN:-191,-221,-173,42,26,-261,0.59,-0.04,1.46
!ANG:-14.49,15.92,14.38,AN:-7,1937,-259,7,79,-115,0.59,-0.04,1.46
!ANG:-8.86,7.58,9.94,AN:1498,-1690,-832,13,133,-120,0.59,-0.04,1.46
!ANG:-8.16,5.66,0.60,AN:1457,-358,-1465,-77,236,-349,0.59,-0.04,1.46
!ANG:-6.05,17.29,-15.29,AN:1568,2568,-2689,-52,254,-234,0.59,-0.04,1.46
!ANG:-4.64,21.42,-25.10,AN:1572,969,-1595,-47,279,-127,0.61,-0.09,1.36
!ANG:-11.79,12.27,-29.10,AN:1063,-1039,-491,-39,232,-180,0.61,-0.09,1.36
!ANG:-20.10,1.69,-31.13,AN:349,-1237,-838,18,134,-178,0.61,-0.09,1.36
!ANG:-21.70,-3.39,-45.19,AN:563,-237,-3520,95,63,-158,0.61,-0.09,1.36
!ANG:-19.20,-0.69,-56.87,AN:471,-15,-3136,-144,261,-401,0.61,-0.09,1.36
!ANG:-15.85,-4.22,-66.87,AN:626,13,-2760,116,155,-118,0.61,-0.09,1.36
!ANG:-21.34,7.96,-75.63,AN:986,901,-2433,80,23,-200,-0.04,0.22,1.46
!ANG:-10.79,2.67,-85.18,AN:1438,-1817,-2327,111,190,-221,-0.04,0.22,1.46
!ANG:-17.28,-7.53,-75.50,AN:-4,-3254,1462,174,-107,-30,-0.04,0.22,1.46
!ANG:-20.35,-23.78,-69.90,AN:-1362,-5887,-167,-199,-264,-538,-0.04,0.22,1.46
!ANG:-8.07,-35.41,-75.10,AN:2117,-2111,-906,107,-397,-400,-0.04,0.22,1.46
!ANG:32.50,-20.68,-98.57,AN:6404,1106,-4828,24,-171,-235,-0.04,0.22,1.46
!ANG:43.28,17.68,-105.32,AN:3226,5596,-6902,-54,116,-289,0.43,1.01,0.27
!ANG:60.80,15.58,-59.73,AN:-1944,10395,1024,-411,354,-102,0.43,1.01,0.27
!ANG:47.47,32.36,-36.43,AN:-4878,1901,4083,-441,-51,34,0.43,1.01,0.27
!ANG:17.88,1.59,-62.87,AN:-5738,-8839,-4357,-322,166,-494,0.43,1.01,0.27
!ANG:9.05,-5.77,-41.01,AN:-919,-880,6325,-492,402,-896,0.43,1.01,0.27
!ANG:14.60,22.96,-19.85,AN:-790,8110,3456,-1028,-92,-386,0.43,1.01,0.27
!ANG:8.43,7.90,-54.81,AN:412,-4024,-6794,-556,-61,-190,1.30,0.51,1.14
!ANG:9.33,-10.04,-73.76,AN:-205,-5094,-3259,-186,74,-358,1.30,0.51,1.14
!ANG:11.12,-18.14,-63.63,AN:949,-1442,1203,-111,-42,-401,1.30,0.51,1.14
!ANG:27.59,-4.53,-73.77,AN:2934,1408,-3536,-167,-85,-62,1.30,0.51,1.14
!ANG:35.93,5.74,-93.78,AN:1847,-83,-5698,-273,149,-240,1.30,0.51,1.14
!ANG:33.51,7.73,-101.22,AN:-27,-1180,-2134,10,196,-57,1.30,0.51,1.14
!ANG:10.93,-4.37,-91.64,AN:-1889,-2796,2618,-157,-25,-279,0.14,0.99,0.78
!ANG:-5.42,-23.00,-77.63,AN:-1919,-3545,2127,-112,-249,-241,0.14,0.99,0.78
!ANG:-5.15,-27.97,-79.49,AN:-272,-896,-570,-43,-261,-339,0.14,0.99,0.78
!ANG:3.46,-19.15,-75.61,AN:1814,1658,395,21,-237,-205,0.14,0.99,0.78
!ANG:20.86,-3.40,-66.63,AN:2253,3080,1214,-154,-165,-131,0.14,0.99,0.78
!ANG:33.28,-5.34,-58.19,AN:1312,2209,816,-164,-119,-20,0.14,0.99,0.78
!ANG:35.04,-10.18,-47.17,AN:248,1306,1562,-191,-49,-104,0.72,0.99,1.06
!ANG:25.58,-19.73,-32.25,AN:-337,729,1964,-226,-59,-141,0.72,0.99,1.06
!ANG:19.77,-26.25,-26.00,AN:-224,750,446,-234,-15,-239,0.72,0.99,1.06
!ANG:11.90,-18.86,-23.91,AN:-909,1713,-397,-185,47,-123,0.72,0.99,1.06
!ANG:-5.65,-37.48,-14.76,AN:-1501,-2492,1110,-181,112,-195,0.72,0.99,1.06
!ANG:-16.47,-30.83,-4.19,AN:91,714,1350,-62,-270,-278,0.72,0.99,1.06
!ANG:-11.00,-24.33,-25.08,AN:-451,1696,-3301,-97,42,-189,0.62,0.66,1.73
!ANG:-11.14,-16.16,-30.67,AN:209,1345,-15,-53,7,-244,0.62,0.66,1.73
!ANG:-12.88,-6.52,-33.07,AN:-583,1159,818,-83,-106,-191,0.62,0.66,1.73
!ANG:2.46,-10.47,-42.53,AN:578,-464,-622,-78,6,-211,0.62,0.66,1.73
!ANG:1.21,-12.47,-46.24,AN:158,-209,0,-11,-40,-221,0.62,0.66,1.73
!ANG:4.22,-7.83,-51.16,AN:299,-110,-182,-26,-18,-230,0.62,0.66,1.73
!ANG:2.69,-5.88,-54.35,AN:-68,-91,85,-42,-10,-223,-0.01,0.60,1.79
!ANG:1.12,-4.60,-56.60,AN:-54,200,384,28,-83,-219,-0.01,0.60,1.79
!ANG:7.40,0.08,-60.94,AN:345,-214,-14,0,-37,-228,-0.01,0.60,1.79
!ANG:8.86,1.11,-62.50,AN:429,-79,487,-65,18,-233,-0.01,0.60,1.79
!ANG:4.59,-3.90,-63.31,AN:128,-229,629,9,-78,-224,-0.01,0.60,1.79
!ANG:8.68,-0.46,-65.79,AN:179,-59,311,13,-77,-229,-0.01,0.60,1.79
!ANG:11.93,1.01,-69.14,AN:299,-285,113,-8,-20,-231,0.25,0.70,1.81
!ANG:9.41,1.34,-65.45,AN:185,10,597,-38,-33,-224,0.25,0.70,1.81
!ANG:7.91,-0.42,-64.49,AN:9,-5,83,-51,-60,-227,0.25,0.70,1.81
!ANG:9.74,-2.96,-64.11,AN:210,-139,11,-29,-30,-228,0.25,0.70,1.81
!ANG:8.71,-3.11,-63.64,AN:195,-129,5,-27,-30,-227,0.25,0.70,1.81
!ANG:7.78,-2.86,-63.34,AN:135,-94,-22,-27,-31,-227,0.25,0.70,1.81
!ANG:7.41,-2.82,-63.08,AN:168,-117,-16,-28,-30,-229,0.31,0.74,1.86
!ANG:7.04,-2.85,-63.35,AN:162,-113,-17,-27,-30,-227,0.31,0.74,1.86
!ANG:6.75,-2.75,-63.62,AN:148,-106,-20,-27,-30,-228,0.31,0.74,1.86
!ANG:6.61,-2.69,-63.83,AN:158,-105,-13,-27,-29,-226,0.31,0.74,1.86
!ANG:6.48,-2.67,-64.02,AN:163,-108,-12,-26,-29,-227,0.31,0.74,1.86
!ANG:6.34,-2.56,-64.20,AN:155,-105,-13,-27,-29,-228,0.31,0.74,1.86
!ANG:6.25,-2.58,-64.36,AN:155,-107,-12,-26,-28,-228,0.30,0.74,1.86""")
# Live reading from Arduino
ports_available = COMPortsAvailable()

# ---- group: DATA FROM TEXT
panel_3 = Panel("""!ANG:-2.42,2.15,1.29,AN:149,-118,-9,-15,-4,-230,0.00,0.00,0.00
!ANG:-3.58,3.20,2.13,AN:147,-118,-9,-14,-3,-230,0.00,0.00,0.00
!ANG:-4.42,3.99,2.92,AN:147,-119,-10,-15,-4,-229,0.00,0.00,0.00
!ANG:-4.89,4.44,3.67,AN:146,-118,-7,-15,-4,-230,0.18,0.56,2.06
!ANG:-5.19,4.71,0.38,AN:154,-122,-6,-15,-2,-230,0.18,0.56,2.06
!ANG:-5.52,4.89,-2.83,AN:154,-122,-8,-14,-3,-230,0.18,0.56,2.06
!ANG:-5.68,5.09,-5.92,AN:150,-122,-10,-15,-4,-229,0.18,0.56,2.06
!ANG:-5.66,5.16,-8.96,AN:156,-123,-8,-15,-3,-229,0.18,0.56,2.06
!ANG:-5.75,5.20,-11.79,AN:149,-120,-9,-15,-4,-231,0.18,0.56,2.06
!ANG:-5.76,5.26,-14.57,AN:146,-118,-7,-15,-4,-230,0.18,0.56,2.06
!ANG:-5.74,5.28,-17.14,AN:149,-121,-8,-14,-4,-230,0.18,0.56,2.06
!ANG:-5.75,5.37,-19.53,AN:145,-120,-8,-16,-4,-229,0.18,0.56,2.06
!ANG:-5.70,5.25,-21.82,AN:151,-124,-7,-15,-5,-230,0.18,0.56,2.06
!ANG:-5.63,5.26,-23.94,AN:147,-123,-9,-14,-4,-229,0.18,0.56,2.06
!ANG:-5.63,5.33,-25.97,AN:151,-123,-7,-15,-4,-229,0.18,0.56,2.06
!ANG:-5.58,5.27,-27.89,AN:161,-128,-9,-15,-4,-228,0.18,0.56,2.06
!ANG:-5.60,5.24,-29.60,AN:153,-129,-10,-15,-4,-229,0.18,0.56,2.06
!ANG:-5.57,5.18,-31.23,AN:158,-133,-7,-15,-4,-227,0.18,0.56,2.06
!ANG:-5.58,5.19,-32.71,AN:161,-133,-8,-15,-1,-231,0.18,0.56,2.06
!ANG:-5.78,5.16,-34.14,AN:164,-131,-10,-13,-4,-229,0.18,0.56,2.06
!ANG:-5.60,5.35,-35.44,AN:175,-122,-5,-14,-4,-229,0.18,0.56,2.06
!ANG:-5.43,5.38,-36.62,AN:186,-123,-8,-14,-4,-229,0.18,0.56,2.05
!ANG:-5.31,5.43,-37.72,AN:185,-115,-4,-14,-3,-228,0.18,0.56,2.05
!ANG:-5.29,5.44,-38.77,AN:196,-122,-12,-14,-3,-230,0.18,0.56,2.05
!ANG:-4.82,6.75,-38.66,AN:263,126,235,-1,-6,-227,0.18,0.56,2.05
!ANG:-4.84,7.55,-39.02,AN:157,-82,106,-9,-5,-230,0.18,0.56,2.05
!ANG:-5.12,8.18,-39.91,AN:124,88,-3,-6,-6,-228,0.18,0.56,2.05
!ANG:-5.05,7.87,-40.87,AN:165,-117,-63,-3,-6,-227,0.15,0.59,2.03
!ANG:-5.65,6.71,-40.48,AN:3,-388,139,-10,-2,-235,0.15,0.59,2.03
!ANG:-5.69,6.69,-41.03,AN:171,-104,-7,-9,-3,-229,0.15,0.59,2.03
!ANG:-5.59,6.74,-41.56,AN:174,-97,-16,-11,-3,-230,0.15,0.59,2.03
!ANG:-5.53,6.64,-42.08,AN:173,-93,-20,-10,-1,-229,0.15,0.59,2.03
!ANG:-5.66,6.60,-42.61,AN:169,-101,-26,-9,-1,-229,0.15,0.59,2.03
!ANG:-5.85,6.85,-43.02,AN:146,-61,-7,-9,-1,-229,0.17,0.57,2.04
!ANG:-5.94,6.74,-43.47,AN:151,-119,-5,-6,-1,-229,0.17,0.57,2.04
!ANG:-5.82,6.93,-43.93,AN:188,-114,-9,-8,-1,-227,0.17,0.57,2.04
!ANG:-5.84,6.83,-44.29,AN:175,-137,0,-10,-1,-230,0.17,0.57,2.04
!ANG:-5.98,6.74,-44.66,AN:141,-100,-5,-9,-5,-230,0.17,0.57,2.04
!ANG:-5.55,6.55,-46.35,AN:221,-117,-300,-3,15,-231,0.17,0.57,2.04
!ANG:-7.04,6.55,-47.94,AN:176,-181,-260,-9,-90,-236,0.15,0.56,2.04
!ANG:-4.29,6.18,-51.32,AN:-429,-204,-788,-8,-15,-225,0.15,0.56,2.04
!ANG:-9.37,6.35,-56.37,AN:-837,26,-1042,-12,59,-236,0.15,0.56,2.04
!ANG:-18.97,5.74,-62.56,AN:-986,159,-1230,9,105,-214,0.15,0.56,2.04
!ANG:-31.16,7.17,-63.18,AN:-1501,-159,-149,-18,112,-232,0.15,0.56,2.04
!ANG:-34.64,3.29,-59.22,AN:-577,-1090,214,-44,120,-263,0.15,0.56,2.04
!ANG:-34.77,0.45,-60.35,AN:8,-502,-443,-59,98,-209,-0.15,-0.21,2.22
!ANG:-28.88,-2.77,-62.96,AN:914,-462,-179,-53,66,-206,-0.15,-0.21,2.22
!ANG:-20.96,-4.95,-64.28,AN:1318,-653,15,-64,80,-227,-0.15,-0.21,2.22
!ANG:-7.17,-8.21,-65.31,AN:3165,-868,1,-106,47,-202,-0.15,-0.21,2.22
!ANG:0.81,-5.71,-63.32,AN:2581,883,686,-85,-31,-209,-0.15,-0.21,2.22
!ANG:2.72,-10.59,-58.60,AN:799,-667,1212,-55,-39,-213,-0.15,-0.21,2.22
!ANG:-0.30,-9.96,-59.89,AN:-311,-393,119,-60,-63,-183,0.60,0.86,1.50
!ANG:-1.01,-7.51,-61.62,AN:-309,110,-281,-81,-29,-240,0.60,0.86,1.50
!ANG:-5.33,-8.75,-60.35,AN:-632,-316,189,-78,-42,-188,0.60,0.86,1.50
!ANG:-8.21,-10.26,-61.98,AN:-754,-354,-278,-70,-8,-190,0.60,0.86,1.50
!ANG:-14.99,-9.87,-63.90,AN:-1233,-120,-350,-78,-21,-227,0.60,0.86,1.50
!ANG:-10.28,-10.24,-65.01,AN:172,-258,-62,-86,-12,-215,0.60,0.86,1.50
!ANG:-6.27,-7.72,-66.83,AN:498,456,-214,-105,-20,-226,0.51,0.38,1.51
!ANG:-6.22,-9.75,-67.35,AN:-73,-55,-155,-107,-8,-210,0.51,0.38,1.51
!ANG:-6.49,-11.64,-66.76,AN:60,-50,50,-99,30,-216,0.51,0.38,1.51
!ANG:-8.46,-11.62,-65.47,AN:312,18,114,-97,46,-232,0.51,0.38,1.51
!ANG:-9.91,-11.91,-65.07,AN:445,-172,-69,-66,85,-219,0.51,0.38,1.51
!ANG:-15.42,-10.27,-65.03,AN:150,-176,-222,-48,53,-192,0.51,0.38,1.51
!ANG:-17.79,-8.04,-67.29,AN:18,-38,-466,-9,89,-216,0.47,0.22,1.13
!ANG:-21.62,-3.91,-69.57,AN:-51,-81,-694,13,59,-220,0.47,0.22,1.13
!ANG:-22.79,0.54,-72.44,AN:-207,-60,-778,32,22,-219,0.47,0.22,1.13
!ANG:-22.12,5.16,-74.79,AN:-388,-20,-754,28,18,-219,0.47,0.22,1.13
!ANG:-20.57,7.81,-75.51,AN:-208,-103,-587,13,-9,-231,0.47,0.22,1.13
!ANG:-16.89,8.63,-74.12,AN:-224,-170,-292,-1,-6,-201,0.47,0.22,1.13
!ANG:-16.25,9.08,-72.80,AN:-187,-128,-205,-42,-5,-233,0.15,0.22,1.62
!ANG:-13.61,5.73,-69.91,AN:-94,-138,87,-78,-14,-227,0.15,0.22,1.62
!ANG:-10.96,1.38,-66.73,AN:16,-80,302,-120,-23,-243,0.15,0.22,1.62
!ANG:-6.28,-2.69,-62.86,AN:708,-42,576,-125,-4,-241,0.15,0.22,1.62
!ANG:-3.13,-5.98,-59.02,AN:931,-14,624,-130,34,-200,0.15,0.22,1.62
!ANG:-7.87,-10.26,-55.25,AN:143,42,518,-103,89,-262,0.15,0.22,1.62
!ANG:-12.80,-10.07,-53.39,AN:100,-220,206,-78,83,-288,0.13,0.13,1.35
!ANG:-16.23,-9.64,-56.69,AN:20,-344,-57,-69,60,-271,0.13,0.13,1.35
!ANG:-17.92,-10.10,-61.50,AN:-35,-456,-406,-40,88,-276,0.13,0.13,1.35
!ANG:-18.62,-8.79,-66.26,AN:363,-405,-411,-43,68,-254,0.13,0.13,1.35
!ANG:-17.57,-7.94,-70.15,AN:505,-490,-288,-24,41,-199,0.13,0.13,1.35
!ANG:-16.89,-6.29,-73.63,AN:370,-430,-253,-29,30,-128,0.13,0.13,1.35
!ANG:-17.15,-5.50,-77.21,AN:459,-295,-307,-22,32,-99,0.43,0.13,1.53
!ANG:-19.47,-3.17,-76.70,AN:92,-8,-189,-32,20,-65,0.43,0.13,1.53
!ANG:-22.83,0.87,-76.66,AN:-150,384,-106,-52,7,-139,0.43,0.13,1.53
!ANG:-23.55,4.81,-76.56,AN:125,531,-3,-47,29,-159,0.43,0.13,1.53
!ANG:-25.14,9.09,-76.26,AN:-121,760,138,-14,75,-219,0.43,0.13,1.53
!ANG:-26.07,10.55,-77.27,AN:-92,593,-256,-17,36,-352,0.43,0.13,1.53
!ANG:-28.26,14.76,-77.56,AN:133,415,-78,-43,55,-234,0.14,0.07,1.45
!ANG:-27.09,11.97,-76.01,AN:-230,348,-19,-67,-2,-288,0.14,0.07,1.45
!ANG:-24.06,11.52,-73.57,AN:-25,273,170,-31,43,-343,0.14,0.07,1.45
!ANG:-24.29,12.43,-72.41,AN:360,-199,-92,-35,45,-366,0.14,0.07,1.45
!ANG:-24.77,12.37,-71.44,AN:468,-492,-213,-34,45,-322,0.14,0.07,1.45
!ANG:-22.42,9.11,-69.57,AN:604,-774,-212,-45,23,-287,0.14,0.07,1.45
!ANG:-17.90,3.77,-67.49,AN:639,-882,-179,-59,16,-279,0.15,0.11,1.44
!ANG:-13.35,-0.96,-65.03,AN:752,-853,49,-38,19,-180,0.15,0.11,1.44
!ANG:-13.82,-2.49,-63.75,AN:203,-617,-40,-24,4,-114,0.15,0.11,1.44
!ANG:-15.93,-2.21,-63.06,AN:95,-440,-103,-42,0,-123,0.15,0.11,1.44
!ANG:-18.05,-0.49,-62.08,AN:16,-128,70,-84,-72,-163,0.15,0.11,1.44
!ANG:-12.16,0.19,-61.84,AN:400,368,102,-81,-50,-226,0.15,0.11,1.44
!ANG:-5.18,-1.52,-59.18,AN:489,143,476,-66,-34,-210,0.41,0.21,1.53
!ANG:-4.26,-2.83,-54.79,AN:6,-107,597,-24,7,-262,0.41,0.21,1.53
!ANG:-3.85,-2.18,-51.05,AN:535,-434,537,-38,-22,-286,0.41,0.21,1.53
!ANG:-1.51,-1.32,-46.35,AN:689,-215,756,-20,14,-221,0.41,0.21,1.53
!ANG:-1.22,1.55,-42.54,AN:760,94,653,-1,44,-207,0.41,0.21,1.53
!ANG:-3.87,4.99,-39.88,AN:527,140,560,-9,17,-213,0.41,0.21,1.53
!ANG:-5.29,6.65,-38.55,AN:263,68,305,-4,53,-188,0.64,0.48,1.40
!ANG:-7.95,7.54,-37.21,AN:381,-134,124,-18,54,-242,0.64,0.48,1.40
!ANG:-10.02,9.02,-37.03,AN:397,370,-32,-36,43,-219,0.64,0.48,1.40
!ANG:-11.68,8.50,-36.84,AN:256,367,-33,-49,58,-203,0.64,0.48,1.40
!ANG:-14.15,5.31,-35.42,AN:211,-207,145,-87,19,-214,0.64,0.48,1.40
!ANG:-14.17,-1.67,-35.59,AN:-45,-349,-258,-130,-15,-215,0.64,0.48,1.40
!ANG:-12.66,-9.92,-37.67,AN:-264,-366,-528,-133,-17,-296,0.59,0.42,1.25
!ANG:-12.12,-11.06,-43.38,AN:76,-207,-921,-137,-55,-267,0.59,0.42,1.25
!ANG:-8.08,-13.55,-48.56,AN:265,-338,-837,-115,-38,-235,0.59,0.42,1.25
!ANG:-4.75,-16.73,-52.90,AN:75,-541,-734,-109,-60,-204,0.59,0.42,1.25
!ANG:-1.52,-19.37,-57.21,AN:-284,-549,-651,-103,-72,-213,0.59,0.42,1.25
!ANG:-0.46,-19.25,-59.15,AN:-473,-367,-259,-94,-45,-228,0.59,0.42,1.25
!ANG:0.29,-17.49,-58.25,AN:108,-247,52,-90,15,-259,0.36,0.25,1.42
!ANG:-3.45,-14.88,-60.87,AN:100,-38,-37,-83,21,-229,0.36,0.25,1.42
!ANG:-8.30,-12.65,-65.20,AN:-306,95,-317,-55,53,-187,0.36,0.25,1.42
!ANG:-12.61,-10.49,-68.72,AN:31,-75,-183,-30,80,-206,0.36,0.25,1.42
!ANG:-18.17,-7.06,-72.67,AN:-64,-116,-286,-21,53,-205,0.36,0.25,1.42
!ANG:-19.51,-4.17,-77.89,AN:31,-100,-444,-10,48,-199,0.36,0.25,1.42
!ANG:-21.24,-2.44,-83.45,AN:-155,-204,-637,13,55,-215,0.24,0.02,1.78
!ANG:-21.91,0.75,-86.13,AN:-99,-217,-728,28,41,-235,0.24,0.02,1.78
!ANG:-21.92,4.34,-89.25,AN:-238,-40,-856,5,5,-214,0.24,0.02,1.78
!ANG:-19.78,5.11,-91.89,AN:-135,-55,-926,5,-14,-212,0.24,0.02,1.78
!ANG:-16.21,5.55,-92.40,AN:-3,-233,-589,-9,-42,-198,0.24,0.02,1.78
!ANG:-13.42,6.32,-91.76,AN:-155,-64,-326,-51,-87,-178,0.24,0.02,1.78
!ANG:-8.53,6.22,-88.27,AN:-134,180,245,-48,-40,-240,0.13,-0.29,1.77
!ANG:-1.11,4.89,-80.44,AN:901,263,454,-60,-24,-216,0.13,-0.29,1.77
!ANG:5.48,0.12,-73.66,AN:1573,-271,363,-103,-17,-253,0.13,-0.29,1.77
!ANG:8.43,-2.75,-60.27,AN:1402,319,1617,-122,222,-290,0.13,-0.29,1.77
!ANG:10.66,-0.67,-51.65,AN:967,160,751,-131,-24,-253,0.13,-0.29,1.77
!ANG:13.00,-0.21,-44.59,AN:1322,989,405,-81,-24,-208,0.13,-0.29,1.77
!ANG:12.54,-2.64,-41.96,AN:965,67,-222,-34,-44,-178,-0.04,0.45,1.45
!ANG:11.06,-3.93,-47.23,AN:269,-607,-335,-38,5,-271,-0.04,0.45,1.45
!ANG:16.78,7.80,-44.09,AN:2380,2224,610,-63,-146,-264,-0.04,0.45,1.45
!ANG:21.49,6.24,-49.04,AN:1081,-235,-416,-24,-133,-200,-0.04,0.45,1.45
!ANG:-2.05,7.16,-53.52,AN:-4774,501,-631,-16,-47,-281,-0.04,0.45,1.45
!ANG:-3.55,8.54,-57.27,AN:-238,186,-189,-17,-26,-232,-0.04,0.45,1.45
!ANG:-1.37,6.58,-55.93,AN:216,-237,732,-15,-34,-218,-0.30,-0.07,2.31
!ANG:-2.05,9.56,-48.34,AN:-396,527,1205,6,20,-231,-0.30,-0.07,2.31
!ANG:-3.30,10.94,-39.53,AN:154,88,1686,-83,-47,-227,-0.30,-0.07,2.31
!ANG:-0.70,4.26,-38.94,AN:138,-51,15,-23,-18,-225,-0.30,-0.07,2.31
!ANG:-1.09,3.61,-39.02,AN:158,-146,-3,-25,-17,-226,-0.30,-0.07,2.31
!ANG:-1.33,3.26,-39.12,AN:182,-93,-2,-25,-18,-226,-0.30,-0.07,2.31
!ANG:-1.47,2.92,-39.20,AN:166,-116,-1,-26,-16,-226,-0.27,0.28,1.88
!ANG:-1.72,2.59,-42.76,AN:164,-123,4,-26,-16,-227,-0.27,0.28,1.88
!ANG:-1.89,2.40,-46.27,AN:163,-113,2,-25,-16,-227,-0.27,0.28,1.88
!ANG:-1.99,2.31,-49.62,AN:165,-125,19,-27,-17,-226,-0.27,0.28,1.88
!ANG:-1.97,2.17,-52.93,AN:170,-115,7,-26,-16,-226,-0.27,0.28,1.88
!ANG:-2.00,2.18,-56.02,AN:178,-109,29,-25,-17,-226,-0.27,0.28,1.88
!ANG:-2.05,2.21,-59.18,AN:157,-119,-1,-26,-17,-226,-0.26,0.29,1.89
!ANG:-2.02,2.18,-62.22,AN:169,-114,0,-26,-16,-226,-0.26,0.29,1.89
!ANG:-2.06,2.14,-65.13,AN:171,-116,1,-27,-17,-226,-0.26,0.29,1.89
!ANG:-2.02,2.05,-67.85,AN:168,-116,0,-26,-18,-227,-0.26,0.29,1.89
!ANG:-1.94,2.06,-70.50,AN:162,-112,-4,-26,-17,-227,-0.26,0.29,1.89
!ANG:-1.92,2.05,-73.03,AN:170,-116,-4,-26,-16,-227,-0.26,0.29,1.89
!ANG:-2.01,2.04,-75.39,AN:164,-114,-4,-27,-17,-227,-0.26,0.29,1.88
!ANG:-1.93,1.96,-77.61,AN:175,-115,4,-26,-17,-226,-0.26,0.29,1.88
!ANG:-1.95,2.00,-79.69,AN:167,-114,-1,-26,-17,-226,-0.26,0.29,1.88
!ANG:-1.91,1.99,-81.60,AN:175,-121,5,-27,-18,-227,-0.26,0.29,1.88
!ANG:-1.78,1.94,-83.43,AN:175,-110,1,-26,-18,-227,-0.26,0.29,1.88
!ANG:-1.73,1.98,-85.12,AN:170,-112,-1,-26,-18,-226,-0.26,0.29,1.88
!ANG:-1.70,2.01,-86.66,AN:171,-113,6,-26,-17,-226,-0.26,0.29,1.88
!ANG:-1.71,2.08,-88.10,AN:183,-101,5,-28,-18,-226,-0.26,0.29,1.88
!ANG:-1.73,1.89,-89.49,AN:161,-116,-7,-28,-17,-234,-0.26,0.29,1.88
!ANG:-1.83,1.79,-90.77,AN:165,-118,-4,-28,-18,-227,-0.26,0.29,1.88
!ANG:-1.82,1.65,-91.98,AN:156,-124,-5,-26,-16,-227,-0.26,0.29,1.88
!ANG:-1.85,1.79,-93.05,AN:183,-110,7,-26,-17,-227,-0.26,0.29,1.88""")

# ---- group: Activation of the port
open_port = OpenClosePort(OpenClosePort=Toggle(False), PortNumber=ports_available, BaudRate=Slider(9600, range=0..10000))

# ----
split = TextSplit(Text=panel_2, Separators=":")
item = ListItem(List=split, Index=0, Wrap=True)  # -> Item, Item1, Item2

# ---- group: Read information from the port
timer = Timer(TimerInterval=20, Target=read)  # disabled
read = SerialReadGeneric(StartReadingValues=Toggle(False), PortNumber=ports_available)  # -> SerialOutput, StatusMessage

# ----
panel_4 = Panel("""-14
-2
27""")
split_2 = TextSplit(Text=item.Item1, Separators=",")
split_3 = TextSplit(Text=item.Item2, Separators=",")
item_2 = ListItem(List=split_3, Index=0, Wrap=True)  # -> Item, Item1, Item2, Item3, Item4, Item5
panel_5 = Panel("""0;-0.034411;-0.020951;-0.086018
1;-0.042415;-0.189628;-0.007650
2;0.043088;-0.703076;0.107875
3;0.087328;-1.018373;-0.076575
4;0.455749;-1.175859;-0.196652
5;-0.265672;-0.003444;0.625812
6;0.956249;1.505441;0.552802
7;1.579918;0.356897;0.694681
8;2.492613;-0.066636;0.458775
9;0.681024;0.518772;0.770493
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""")
panel_6 = Panel("""0;0.028168;-0.194031;-0.984070
1;0.004440;-0.146454;-1.027344
2;0.029846;-0.176529;-0.973862
3;0.075317;-0.122025;-0.993271
4;0.020081;-0.014053;-1.227814
5;0.022598;0.045563;-1.197617
6;-0.016907;0.051071;-1.004471
7;-0.030655;-0.094116;-0.904037
8;-0.172928;-0.178513;-0.937851
9;-0.139938;-0.175247;-0.968567
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""")
xy = XYPlane(Origin=Point(0, 0, 0))
item_3 = ListItem(List=split_2, Index=0, Wrap=True)  # -> Item, Item1, Item2
panel_7 = Panel("""0;-0.004604;0.022542;0.010965
1;-0.017495;0.001273;0.011848
2;-0.020384;0.001593;0.005867
3;-0.004072;0.012064;-0.011234
4;-0.001936;-0.015405;0.000268
5;-0.002952;-0.010335;-0.006744
6;-0.022517;-0.032053;0.000603
7;-0.008644;0.002150;-0.005246
8;-0.015369;-0.001627;0.002546
9;-0.024865;-0.003676;-0.015067
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""")
subtraction = Subtraction(A=[item_2.Item3, item_2.Item4, item_2.Item5], B=panel_4)
division = Division(A=subtraction, B=256)
multiplication = Multiplication(A=division, B=9.81)
panel_8 = Panel(open_port)
panel_9 = Panel(read.SerialOutput)
item_4 = ListItem(List=multiplication, Index=0, Wrap=True)  # -> Item, Item1, Item2
split_4 = TextSplit(Text=read.SerialOutput, Separators=":")
subtraction_2 = Subtraction(A=item_4.Item2, B="-9.81")
item_5 = ListItem(List=split_4, Index=1, Wrap=True)
vec = VectorXYZ(XComponent=item_4.Item, YComponent=item_4.Item1, ZComponent=item_4.Item2)  # -> Vector, Length
rev = Reverse(Vector=flatten(vec.Vector))
split_5 = TextSplit(Text=item_5, Separators=",")  # disabled
panel_10 = Panel(vec.Vector)
orient = Orient(Geometry=flatten(rev), Source=PlaneXY(0, 0, 0), Target=PlaneXY(0, 0, 0))  # -> Geometry, Transform
split_6 = TextSplit(Text=panel_7, Separators=";")
panel_11 = Panel(split_6)
pt = Point(Point(0, 0, 0))
data = Data(Tree({0}: [-1.809908023], {1}: [-74.63484949], {2}: [38.02412698]))
item_6 = ListItem(List=split_5, Index=0, Wrap=True)  # -> Item, Item1, Item2, Item3, Item4, Item5, Item6
vec_2 = VectorXYZ(XComponent=item_6.Item3, YComponent=item_6.Item4, ZComponent=item_6.Item5)  # -> Vector, Length
item_7 = ListItem(List=flatten(vec.Vector), Index=Slider(223, range=0..1000), Wrap=True)
item_8 = ListItem(List=split_6, Index=0, Wrap=True)  # -> flatten(Item), flatten(Item1), flatten(Item2), flatten(Item3)
lng = ListLength(List=item_8.Item1)
vdis = VectorDisplay(Anchor=pt, Vector=flatten(item_7))
Z = UnitZ(Factor=Slider(1, range=0..10))
orient_2 = Orient(Source=PlaneXY(0, 0, 0), Target=PlaneXY(0, 0, 0))  # -> Geometry, Transform
transform = Transform(Geometry=vec.Vector)
vec_3 = VectorXYZ(XComponent=item_8.Item1, YComponent=item_8.Item2, ZComponent=item_8.Item3)  # -> Vector, Length
ma = MassAddition(Input=vec_3.Vector)  # -> Result, PartialResults
division_2 = Division(A=ma.Result, B=lng)
subtraction_3 = Subtraction(A=vec_3.Vector, B=division_2)
item_9 = ListItem(List=vec_3.Vector, Index=0, Wrap=True)
devec = DeconstructVector(Vector=subtraction_3)  # -> XComponent, YComponent, ZComponent
panel_12 = Panel(vec_3.Vector)
rad = Radians(Degrees=[item_3.Item, item_3.Item1, item_3.Item2])
pt_2 = Point(vec.Vector)
addition = Addition(A=vec_3.Vector, B=Z)
subtraction_4 = Subtraction(A=vec_3.Vector, B=item_9)
deplane = DeconstructPlane(Plane=orient_2.Geometry)  # -> Origin, XAxis, YAxis, ZAxis
pt_3 = Point(Point(0, 0, 0))
panel_13 = Panel(addition)
python = PythonScript(x=devec.XComponent, y=devec.YComponent, z=devec.ZComponent, t=Slider(1, range=0..1))  # -> out, dx, dy, dz; inputs x: list, y: list, z: list
# ---------- python: Python ----------
import rhinoscriptsyntax as rs
import Rhino.Geometry as rg

dx=[0]
vx=[0]

dy=[0]
vy=[0]

dz=[0]
vz=[0]

for i in range(1,len(x)):
    vx.append((x[i-1]+(x[i]-x[i-1])/2)*t+vx[i-1])
    dx.append((vx[i-1]+(vx[i]-vx[i-1])/2)*t+dx[i-1])
    vy.append((y[i-1]+(y[i]-y[i-1])/2)*t+vy[i-1])
    dy.append((vy[i-1]+(vy[i]-vy[i-1])/2)*t+dy[i-1])
    vz.append((z[i-1]+(z[i]-z[i-1])/2)*t+vz[i-1])
    dz.append((vz[i-1]+(vz[i]-vz[i-1])/2)*t+dz[i-1])

#    vy.append((y[i]-y[i-1])/2*t+vy[i-1])
#    dy.append((y[i]-y[i-1])/2*t*t+vy[i-1]*t+dy[i-1])
#    vz.append((z[i]-z[i-1])/2*t+vz[i-1])
#    dz.append((z[i]-z[i-1])/2*t*t+vz[i-1]*t+dz[i-1])
# ---------- end python ----------
panel_14 = Panel("""roll
pitch
yaw""")
item_10 = ListItem(List=rad, Index=0, Wrap=True)  # -> Item, Item1, Item2
vdis_2 = VectorDisplay(Anchor=pt_3, Vector=addition)
panel_15 = Panel("up=(sin(roll)*sin(yaw)+cos(roll)*sin(pitch)*cos(yaw),sin(roll)*cos(yaw)-cos(roll)*sin(pitch)*sin(yaw),-cos(roll)*cos(pitch))")
pt_4 = ConstructPoint(XCoordinate=python.dx, YCoordinate=python.dy, ZCoordinate=python.dz)
S = KMLStyle(FillColor=RGB(255, 255, 255), CurveColor=RGB(0, 0, 0), CurveWidth=1)
lng_2 = ListLength(List=flatten(addition))
kml_out = KMLExporter(Style=null, AltitudeMode="absolute")
panel_16 = Panel("axis=(cos(pitch)*cos(yaw),-cos(pitch)*sin(yaw),sin(pitch)) ")
intcrv = Interpolate(Vertices=orient_2.Geometry, Degree=3, Periodic=False, KnotStyle=1)  # -> Curve, Length, Domain

# ---- group: NORMAL
expression = Expression(r=item_10.Item, y=item_10.Item2, p=item_10.Item1, Expression="sin(r)*cos(y)-cos(r)*sin(p)*sin(y)")
expression_2 = Expression(r=item_10.Item, y=item_10.Item2, p=item_10.Item1, Expression="sin(r)*sin(y)+cos(r)*sin(p)*cos(y)")
expression_3 = Expression(r=item_10.Item, p=item_10.Item1, Expression="-cos(r)*cos(p)")

# ----
intcrv_2 = Interpolate(Vertices=pt_4, Degree=3, Periodic=False, KnotStyle=1)  # -> Curve, Length, Domain
path = FilePath("C:\Users\carne\Downloads\Nouveau parcours.kml")
loop_start = LoopStart(Repeat=expr("x-1", lng_2), Trigger=Button(), Data=pt_3)  # -> port, Counter, Data; disabled
item_11 = ListItem(List=flatten(addition), Index=loop_start.Counter, Wrap=True)  # disabled

# ---- group: DIRECTION
expression_4 = Expression(p=item_10.Item1, y=item_10.Item2, Expression="-cos(p)*sin(y)")
expression_5 = Expression(p=item_10.Item1, y=item_10.Item2, Expression="cos(p)*cos(y)")
expression_6 = Expression(p=item_10.Item1, Expression="sin(p)")

# ----
xml = XmlParser(Path=path)  # -> Elements, Values, AttributeNames, AttributeValues, CData
move = Move(Geometry=loop_start.Data, Motion=item_11)  # -> Geometry, Transform
panel_17 = Panel(xml.Elements)
vec_4 = VectorXYZ(XComponent=expression_2, YComponent=expression, ZComponent=expression_3)  # -> Vector, Length
vec_5 = VectorXYZ(XComponent=expression_5, YComponent=expression_4, ZComponent=expression_6)  # -> Vector, Length
pt_5 = Point(Point(0, 0, 0))
xprod = CrossProduct(VectorA=vec_4.Vector, VectorB=vec_5.Vector, Unitize=False)  # -> Vector, Length
loop_end = LoopEnd(port=loop_start.port, Exit=False, Data=move.Geometry, pausedState=False, state="Constant & Record", TimeOutVal=0)  # -> flatten(Data)
number_slider = Slider(166, range=0..1000)
item_12 = ListItem(Index=number_slider, Wrap=True)
rec = DataRecorder(vec_4.Vector, DataLimit=-10, RecordData=True)
pl = ConstructPlane(Origin=Point(0, 0, 0), XAxis=vec_5.Vector, YAxis=xprod.Vector)  # -> flatten(Plane)
orient_3 = Orient(Geometry=vec_2.Vector, Source=pl, Target=xy)  # -> Geometry, Transform
devec_2 = DeconstructVector(Vector=orient_3.Geometry)  # -> XComponent, YComponent, ZComponent
merge = Merge(Data1=devec_2.XComponent, Data2=devec_2.YComponent, Data3=devec_2.ZComponent)  # -> simplify(graft(Result))
multiplication_2 = Multiplication(A=merge, B=9.81)
subtraction_5 = Subtraction(A=multiplication_2, B=data)
panel_18 = Panel(subtraction_5)
panel_19 = Panel(merge)
rec_2 = DataRecorder(subtraction_5, DataLimit=-10, RecordData=False)
panel_20 = Panel(rec_2)
data_2 = Data(rec_2)
viewer = ParamViewer(rec_2)
bang = ExplodeTree(Data=data_2)  # -> Branch0, Branch1, Branch2
vec_6 = VectorXYZ(XComponent=0, YComponent=0, ZComponent=Slider(9.81, range=0..10))  # -> Vector, Length
orient_4 = Orient(Geometry=flatten(vec.Vector), Source=PlaneXY(0, 0, 0), Target=pl)  # -> Geometry, Transform
intcrv_3 = Interpolate(Vertices=loop_end, Degree=3, Periodic=False, KnotStyle=1)  # -> Curve, Length, Domain
item_13 = ListItem(List=reverse(rec), Index=1, Wrap=True)  # -> Item, Item1
devec_3 = DeconstructVector(Vector=flatten(vec_4.Vector))  # -> XComponent, YComponent, ZComponent
subtraction_6 = Subtraction(A=orient_4.Geometry, B=vec_6.Vector)
devec_4 = DeconstructVector(Vector=subtraction_6)  # -> XComponent, YComponent, ZComponent
python_2 = PythonScript(x=devec_4.XComponent, y=devec_4.YComponent, z=devec_4.ZComponent, t=Slider(0.045, range=0..1.01))  # -> out, dx, dy, dz; inputs x: list, y: list, z: list
# ---------- python_2: Python ----------
import rhinoscriptsyntax as rs
import Rhino.Geometry as rg

dx=[0]
vx=[0]

dy=[0]
vy=[0]

dz=[0]
vz=[0]

for i in range(1,len(x)):
    vx.append(x[i]*t+vx[i-1])
    dx.append(x[i]*t*t+vx[i-1]*t+dx[i-1])
    vy.append(y[i]*t+vy[i-1])
    dy.append(y[i]*t*t+vy[i-1]*t+dy[i-1])
    vz.append(z[i]*t+vz[i-1])
    dz.append(z[i]*t*t+vz[i-1]*t+dz[i-1])
# ---------- end python_2 ----------
pt_6 = ConstructPoint(XCoordinate=python_2.dy, YCoordinate=python_2.dz, ZCoordinate=python_2.dx)
intcrv_4 = Interpolate(Vertices=pt_6, Degree=3, Periodic=False, KnotStyle=1)  # -> Curve, Length, Domain
item_14 = ListItem(List=pl, Index=number_slider, Wrap=True)
orient_5 = Orient(Geometry=flatten(item_12), Source=PlaneXY(0, 0, 0), Target=item_14)  # -> Geometry, Transform
box = CenterBox(Base=pl, X=Slider(2, range=0..10), Y=1, Z=1)
project = Project(Geometry=flatten(vec_4.Vector), Plane=PlaneXY(0, 0, 0))  # -> Geometry, Transform
vdis_3 = VectorDisplay(Anchor=pt_5, Vector=project.Geometry)
move_2 = Move(Geometry=item_13.Item1, Motion=item_13.Item)  # -> Geometry, Transform
number_slider_2 = Slider(100, range=0..100)
loop_start_2 = LoopStart(Repeat=Slider(227, range=0..1000), Trigger=Button(), Data=pt_5)  # -> port, Counter, Data
addition_2 = Addition(A=loop_start_2.Counter, B=Slider(0, range=0..10))
panel_21 = Panel(project.Geometry)
item_15 = ListItem(List=panel_21, Index=addition_2, Wrap=True)
move_3 = Move(Geometry=loop_start_2.Data, Motion=item_15)  # -> Geometry, Transform
loop_end_2 = LoopEnd(port=loop_start_2.port, Exit=False, Data=move_3.Geometry, pausedState=False, state="Constant & Record", TimeOutVal=0)
intcrv_5 = Interpolate(Vertices=flatten(loop_end_2), Degree=3, Periodic=False, KnotStyle=1)  # -> Curve, Length, Domain
panel_22 = Panel(loop_end_2)
